# Grasshopper definition SPhyR_2D.gh (Grasshopper 1.0.7)
# plug-ins: Millipede

grid_size = Slider(10, range=0..100)
ghpython_script = GhPythonScript(x=grid_size)  # -> out, a; inputs x: Int32
# ---------- ghpython_script: Python ----------
__author__ = "pdsie"
__version__ = "2024.11.02"

import rhinoscriptsyntax as rs



from Grasshopper import DataTree
from Grasshopper import DataTree as GHDataTree
from Grasshopper.Kernel.Data import GH_Path

def GenerateLocations():
    locations = DataTree[object]()  # Initialize a new DataTree
    path_index = 0  # Start with an index for the tree paths
    x_plus_1 = x + 1
    for x_left in range(x_plus_1):
        for x_right in range(x_plus_1):
            if x_left < x_right and x_right - x_left >= 3: 
                for x1_left in range(x_plus_1):
                    for x1_right in range(x_plus_1):
                        if x1_left < x1_right and x1_right - x1_left >= 3: 
                            # Create a new path for each group
                            path = GH_Path(path_index)
                            # Add each item individually in the current path
                            locations.Add(x_left, path)
                            locations.Add(x_right, path)
                            locations.Add(x1_left, path)
                            locations.Add(x1_right, path)
                            path_index += 1

    return locations

a = GenerateLocations()
# ---------- end ghpython_script ----------
# Run Script
run = BooleanToggle(False)
list_item = ListItem(List=ghpython_script.a, Index=0, Wrap=True)  # -> flatten(Item)
number_slider = Slider(1295, range=0..10000)
list_length = ListLength(List=list_item)  # -> expr("x-1", Length)
ghpython_script_2 = GhPythonScript(min_index=Slider(0, range=0..100), max_index=list_length, run=run)  # -> out, loop_output; inputs min_index: Int32, max_index: Int32
# ---------- ghpython_script_2: Python ----------
import Grasshopper.Kernel as gh
import scriptcontext as sc
import time

def loop_index(min_val, max_val, run):
    """
    Iterates from min_val to max_val, returning a single number at a time.
    Starts looping only when 'run' is True, using a while loop for continuous updates.
    """
    if min_val > max_val:
        ghenv.Component.AddRuntimeMessage(gh.GH_RuntimeMessageLevel.Error, "min_val should be less than or equal to max_val.")
        return min_val
    
    if not run:
        return min_val  # Stop at min_val when not running
    
    # Retrieve the last stored value
    if 'current_val' not in sc.sticky:
        sc.sticky['current_val'] = min_val
    
    while run:
        current_val = sc.sticky['current_val']
        next_val = current_val + 1 if current_val < max_val else min_val
        sc.sticky['current_val'] = next_val
        
        # Expire the solution to trigger continuous update
        ghenv.Component.ExpireSolution(True)
        
        # Introduce a small delay to allow UI updates
        time.sleep(1.0)
        
        return next_val  # Return updated value per loop iteration

# Generate loop index output
loop_output = loop_index(min_index, max_index, run)
# ---------- end ghpython_script_2 ----------
index = Panel(ghpython_script_2.loop_output)
tree_branch = TreeBranch(Tree=ghpython_script.a, Path=ghpython_script_2.loop_output, MaintainPaths=True)
list_item_2 = ListItem(List=tree_branch, Index=0, Wrap=True)  # -> flatten(Item), flatten(Item1), flatten(Item2), flatten(Item3)

construct_point = ConstructPoint(XCoordinate=list_item_2.Item2, YCoordinate=expr("x-1", grid_size), ZCoordinate=0)
construct_point_2 = ConstructPoint(XCoordinate=list_item_2.Item3, YCoordinate=expr("x+1", grid_size), ZCoordinate=0)
rectangle_2pt = Rectangle2Pt(Plane=PlaneXY(0, 0, 0), PointA=construct_point, PointB=construct_point_2, Radius=0)  # -> Rectangle, Length
Y = UnitY(Factor=Slider(-3000, range=-3000..0))
_2d_load_region = _2DLoadRegion(Boundary=rectangle_2pt.Rectangle, Load=Y)

construct_point_3 = ConstructPoint(XCoordinate=list_item_2.Item3, YCoordinate=grid_size, ZCoordinate=0)
rectangle_2pt_2 = Rectangle2Pt(Plane=PlaneXY(0, 0, 0), PointA=construct_point, PointB=construct_point_3, Radius=0)  # -> Rectangle, Length
explode = Explode(Curve=rectangle_2pt_2.Rectangle, Recursive=True)  # -> Segments, Vertices
list_item_3 = ListItem(List=explode.Segments, Index=0, Wrap=True)  # -> Item, Item1, Item2
curve = Curve(list_item_3.Item2)
divide_distance = DivideDistance(Curve=curve, Distance=0.5)  # -> Points, Tangents, Parameters
cull_pattern = CullPattern(List=divide_distance.Points, CullPattern=[False, True])
surface = Surface(rectangle_2pt_2.Rectangle)
vector_display = VectorDisplay(Anchor=cull_pattern, Vector=expr("x*0.3", Vector(0, -1, 0)))

construct_point_4 = ConstructPoint(XCoordinate=grid_size, YCoordinate=grid_size, ZCoordinate=0)
rectangle_2pt_3 = Rectangle2Pt(Plane=PlaneXY(0, 0, 0), PointA=Point(0, 0, 0), PointB=construct_point_4, Radius=0)  # -> Rectangle, Length
square = Square(Plane=rectangle_2pt_3.Rectangle, Size=1, ExtentX=grid_size, ExtentY=grid_size)  # -> Cells, Points
polygon_center = PolygonCenter(Polyline=square.Cells)  # -> CenterV, CenterE, CenterA
_2d_boundary_region = _2DBoundaryRegion(Boundary=rectangle_2pt_3.Rectangle, IsVoid=False)

construct_point_5 = ConstructPoint(XCoordinate=list_item_2.Item, YCoordinate=-1, ZCoordinate=0)
construct_point_6 = ConstructPoint(XCoordinate=list_item_2.Item1, YCoordinate=1, ZCoordinate=0)
rectangle_2pt_4 = Rectangle2Pt(Plane=PlaneXY(0, 0, 0), PointA=construct_point_5, PointB=construct_point_6, Radius=0)  # -> Rectangle, Length
mat = MillC_StockSupportType(X=True, Y=True, Z=True, RX=True, RY=True, RZ=True)
_2d_support_region = _2DSupportRegion(Boundary=rectangle_2pt_4.Rectangle, SupportType=mat, AmendExistingSupports=False, Displacement=Vector(0, 0, 0))

construct_point_7 = ConstructPoint(XCoordinate=list_item_2.Item, YCoordinate=0, ZCoordinate=0)
rectangle_2pt_5 = Rectangle2Pt(Plane=PlaneXY(0, 0, 0), PointA=construct_point_7, PointB=construct_point_6, Radius=0)  # -> Rectangle, Length
pattern_hatch = PatternHatch(Boundaries=rectangle_2pt_5.Rectangle, Pattern=1, Scale=1, Angle=degrees(45))
surface_2 = Surface(rectangle_2pt_5.Rectangle)

curve_2 = Curve(rectangle_2pt_3.Rectangle)
move = Move(Geometry=curve_2, Motion=Vector(0, 0, -1))  # -> Geometry, Transform
custom_preview = CustomPreview(
    Geometry=move.Geometry,
    Material={diffuse=RGB(192, 192, 192), emission=RGB(192, 192, 192), shine=0.5, specular=RGB(255, 255, 255), transparency=0})
topostruct_2d_model = Topostruct2DModel(ModelComponents=[_2d_load_region, _2d_boundary_region, _2d_support_region], XResolution=grid_size)  # -> FEModel, CellCentres, CellSize

topostruct_2d_solver = Topostruct2DSolver(
    FEModel=topostruct_2d_model.FEModel,
    SelfWeightCoefficient=0,
    OptimizationIterations=Slider(10, range=0..10),
    Smoothing=0.1,
    Penalization=3,
    TargetDensity=Slider(0.1, range=0..1),
    MinimumDensity=0.001,
    DeleteThreshold=0.5,
    PeriodicX=False,
    PeriodicY=False,
    LoadCase=0,
    AllCases=True,
    CompliantMechanism=False)  # -> FEModel, MaxDeflection

_2d_cell_results = _2DCellResults(FEModel=topostruct_2d_solver.FEModel)  # -> PrincipalStressPlanes, PrincipalStresses, VonMisesStress, Density

pt = Point(Point(5, 5, 0))
division = Division(A=Slider(0, range=0..4), B=topostruct_2d_solver.MaxDeflection)
_2d_iso_contour = _2DIsoContour(FEModel=topostruct_2d_solver.FEModel, Deflection=0, IsoContourValue=Slider(0.377, range=0..1))
stress_lines = StressLines(FEModel=topostruct_2d_solver.FEModel, Seeds=pt)  # -> Curves1, Curves2
_2d_mesh_results = _2DMeshResults(FEModel=topostruct_2d_solver.FEModel, Deflection=division, ColorMode=0)

point_in_curve = PointInCurve(Point=flatten(_2d_cell_results.PrincipalStressPlanes), Curve=rectangle_2pt.Rectangle)  # -> Relationship, Point
point_in_curve_2 = PointInCurve(Point=flatten(_2d_cell_results.PrincipalStressPlanes), Curve=rectangle_2pt_4.Rectangle)  # -> Relationship, Point
item_index = ItemIndex(List=point_in_curve_2.Relationship, Item=point_in_curve_2.Relationship)
cull_pattern_2 = CullPattern(List=item_index, CullPattern=point_in_curve_2.Relationship)
cull_pattern_3 = CullPattern(List=item_index, CullPattern=point_in_curve.Relationship)
merge = Merge(Data1=cull_pattern_3, Data2=cull_pattern_2)  # -> flatten(Result)
replace_items = ReplaceItems(List=_2d_cell_results.Density, Item=1, Indices=merge, Wrap=False)
remap_numbers = RemapNumbers(Value=replace_items, Source=Domain(0, 1), Target=Domain(0.1, 0.2))  # -> Mapped, Clipped
gradient = Gradient(
    LowerLimit=1,
    UpperLimit=0,
    Parameter=replace_items,
    stops=[0: RGB(255, 29, 37), 0.5: RGB(255, 147, 30), 1: RGB(20, 223, 180)])
point = Point(_2d_cell_results.PrincipalStressPlanes)
smaller = SmallerThan(FirstNumber=Slider(0.09, range=0..1), SecondNumber=replace_items)  # -> SmallerThan, OrEqualTo
argb = SplitARGB(Colour=gradient)  # -> Alpha, Red, Green, Blue
frgb = ColourRGBF(Alpha=smaller.SmallerThan, Red=argb.Red, Green=argb.Green, Blue=argb.Blue)
item_index_2 = ItemIndex(List=point, Item=point)
dispatch = Dispatch(List=frgb, DispatchPattern=smaller.SmallerThan)  # -> ListA, ListB
dispatch_2 = Dispatch(List=item_index_2, DispatchPattern=smaller.SmallerThan)  # -> ListA, ListB
dispatch_3 = Dispatch(List=point, DispatchPattern=smaller.SmallerThan)  # -> ListA, ListB

discontinuity = Discontinuity(Curve=curve_2, Level=1)  # -> Points, Parameters
list_item_4 = ListItem(List=discontinuity.Points, Index=0, Wrap=True)  # -> Item, Item1, Item2, Item3
line_sdl = LineSDL(
    Start=graft(discontinuity.Points),
    Direction=[Vector(0, -1, 0), Vector(1, 0, 0), Vector(0, 1, 0), Vector(-1, 0, 0)],
    Length=0.25)
unit_y = UnitY(Factor=0.4)
move_2 = Move(Geometry=list_item_4.Item3, Motion=Vector(0.3, 0.2, 0))  # -> Geometry, Transform
ghpython_script_3 = GhPythonScript(curves=flatten(line_sdl), thickness=2, color=ColourSwatch(SwatchColor=RGB(0, 0, 0)))  # -> out, a; inputs curves: list of Curve, color: Color
# ---------- ghpython_script_3: Python ----------
import Rhino
import Rhino.Display as rd
import scriptcontext as sc

STICKY_KEY = "shared_style_conduits"

# Helper to disable and remove previous conduits
def clear_conduits():
    stored = sc.sticky.get(STICKY_KEY, None)
    if stored:
        # Ensure it's a list
        if isinstance(stored, list):
            for conduit in stored:
                if conduit: conduit.Enabled = False
        else:
            # If it was a single conduit
            stored.Enabled = False
    sc.sticky[STICKY_KEY] = []

# Custom display conduit
class SharedStyleConduit(rd.DisplayConduit):
    def __init__(self, curves, color, thickness):
        self.curves = curves
        self.color = color
        self.thickness = thickness
        self.Enabled = True

    def DrawForeground(self, e):
        for crv in self.curves:
            if crv:
                e.Display.DrawCurve(crv, self.color, self.thickness)

# First run per solution: clear old conduits
if sc.sticky.get("shared_style_conduit_cleared", False) is False:
    clear_conduits()
    sc.sticky["shared_style_conduit_cleared"] = True

# Create and register new conduit
if curves and thickness > 0:
    conduit = SharedStyleConduit(curves, color, thickness)
    current = sc.sticky.get(STICKY_KEY, [])
    if not isinstance(current, list):
        current = [current]
    current.append(conduit)
    sc.sticky[STICKY_KEY] = current
    Rhino.RhinoDoc.ActiveDoc.Views.Redraw()
# ---------- end ghpython_script_3 ----------
move_3 = Move(Geometry=move_2.Geometry, Motion=unit_y)  # -> Geometry, Transform
move_4 = Move(Geometry=list_item_4.Item, Motion=Vector(0.3, -0.2, 0))  # -> Geometry, Transform
list_length_2 = ListLength(List=cull_pattern_2)
list_length_3 = ListLength(List=cull_pattern_3)
text = Text(list_length_2)
text_2 = Text(ghpython_script_2.loop_output)
text_3 = Text(list_length_3)
concatenate = Concatenate(FragmentA="Support Count: ", FragmentB=text)
concatenate_2 = Concatenate(FragmentA="Index: ", FragmentB=text_2)
concatenate_3 = Concatenate(FragmentA="Load Count: ", FragmentB=text_3)
text_tag_3d = TextTag3D(Location=move_4.Geometry, Text=concatenate, Size=0.2, Justification=1)
text_tag_3d_2 = TextTag3D(Location=move_3.Geometry, Text=concatenate_2, Size=0.2, Justification=7)
text_tag_3d_3 = TextTag3D(Location=move_2.Geometry, Text=concatenate_3, Size=0.2, Justification=7)

proximity_2d = Proximity2D(Points=flatten(dispatch_3.ListA), Plane=PlaneXY(0, 0, 0), Group=10, MinRadius=0.8, MaxRadius=1.5)  # -> flatten(Links), Topology
dispatch_4 = Dispatch(List=remap_numbers.Mapped, DispatchPattern=smaller.SmallerThan)  # -> ListA, ListB
cloud = CloudDisplay(Points=graft(dispatch_3.ListA), Colours=graft(dispatch.ListA), Size=graft(dispatch_4.ListA), SpriteType=1)
cloud_2 = CloudDisplay(Points=dispatch_3.ListB, Colours=ColourSwatch(SwatchColor=RGB(0, 0, 0)), Size=Slider(0.05, range=0..0.1), SpriteType=1)
line = Line(proximity_2d.Links)

# ---- group: Topology
data = Data(proximity_2d.Topology)

# ----
panel = Panel("C:\Users\pdsie\Desktop\SPhyR_2D_10x10")
list_item_5 = ListItem(List=dispatch_2.ListA, Index=data, Wrap=True)  # -> simplify(Item)

# ---- group: Density
data_2 = Data(replace_items)

# ---- group: Locations
data_3 = Data(point)

# ----
ghpython_script_4 = GhPythonScript(x=list_item_5)  # -> out, flatten(a); inputs x: list
# ---------- ghpython_script_4: Python ----------
__author__ = "pdsie"
__version__ = "2024.11.25"

import rhinoscriptsyntax as rs

a = str(x)
# ---------- end ghpython_script_4 ----------
deconstruct = Deconstruct(Point=data_3)  # -> XComponent, YComponent, ZComponent
integer = Integer(flatten(dispatch_2.ListA))
text_4 = Text(ghpython_script_2.loop_output)
ghpython_script_5 = GhPythonScript(
    density=data_2,
    x=deconstruct.XComponent,
    y=deconstruct.YComponent,
    z=deconstruct.ZComponent,
    node_indexes_with_neighbours=integer,
    neighbours=ghpython_script_4.a,
    static_indexes=merge)  # -> a; inputs density: list, x: list, y: list, z: list, node_indexes_with_neighbours: list of Int32, neighbours: list, static_indexes: list of Int32
# ---------- ghpython_script_5: Python ----------
__author__ = "pdsie"
__version__ = "2024.11.25"
                
import rhinoscriptsyntax as rs
                
lines = []
                
for i in range(len(density)):
    n = []
    if i in node_indexes_with_neighbours:
        n_index = node_indexes_with_neighbours.index(i)
        n = neighbours[n_index]
    static = i in static_indexes
    line = "{},{},{},{},{},{},{}".format(i, x[i], y[i], z[i], density[i], static, str(n))
    lines.append(line)
                
a = lines
# ---------- end ghpython_script_5 ----------
concatenate_4 = Concatenate(Fragment_A=panel, Fragment_B="\frames\", C=grid_size, D="_", A=text_4, B=".png")
ghpython_script_6 = GhPythonScript(path=concatenate_4)  # -> out, a
# ---------- ghpython_script_6: Python ----------
import Rhino
import System
import scriptcontext as sc
import Grasshopper.Kernel as gh


def capture_view(filepath, width=920, height=920):
    try:
        # Get the active Rhino viewport
        view = sc.doc.Views.ActiveView
        if not view:
            raise Exception("No active view found")
        
        # Get the viewport display settings
        display_mode = view.ActiveViewport.DisplayMode
        
        # Take screenshot and save
        bitmap = view.CaptureToBitmap(System.Drawing.Size(width, height))
        if not bitmap:
            raise Exception("Failed to capture viewport")
        
        # Save the image
        bitmap.Save(filepath, System.Drawing.Imaging.ImageFormat.Png)
        print("Screenshot saved at:", filepath)
        return True
    except Exception as e:
        print("Error:", e)
        return False


# Grasshopper input parameters
file_path = path  # Change the path as needed

# Execute the screenshot function
if capture_view(file_path):
    ghenv.Component.AddRuntimeMessage(gh.GH_RuntimeMessageLevel.Remark, "Screenshot saved successfully.")
else:
    ghenv.Component.AddRuntimeMessage(gh.GH_RuntimeMessageLevel.Error, "Failed to save screenshot.")
# ---------- end ghpython_script_6 ----------
ghpython_script_7 = GhPythonScript(prefix=text_4, name="SPhyR_2D.csv", lines=ghpython_script_5, directory=panel)  # -> out, a; inputs lines: list
# ---------- ghpython_script_7: Python ----------
__author__ = "pdsie"
__version__ = "2024.11.25"

import rhinoscriptsyntax as rs

import os

# Inputs: 'lines' (list of strings), 'directory' (target directory)
# Example:
# lines = ["ID,Name,Value", "1,Alice,100", "2,Bob,200"]
# directory = "C:/example/path"

# Check if directory exists
if not os.path.exists(directory):
    raise ValueError("The specified directory does not exist.")

# Define the file path for the CSV
file_path = os.path.join(directory, "{}_{}".format(prefix, name))

# Write to the file
try:
    with open(file_path, "w") as file:
        # Write each string as a new line in the CSV
        for line in lines:
            file.write(line + "\n")
    result = "CSV successfully written to {}".format(file_path)
except Exception as e:
    result = "Error writing CSV: {}".format(str(e))

# Output the result for feedback
a = result
# ---------- end ghpython_script_7 ----------
panel_2 = Panel(ghpython_script_7.a)
