# Grasshopper definition SPhyR_3D.gh (Grasshopper 1.0.7)
# plug-ins: Millipede

grid_size = Slider(10, range=0..100)
ghpython_script = GhPythonScript(x=grid_size)  # -> out, a; inputs x: Int32
# ---------- ghpython_script: Python ----------
__author__ = "pdsie"
__version__ = "2024.11.02"

import rhinoscriptsyntax as rs



from Grasshopper import DataTree
from Grasshopper import DataTree as GHDataTree
from Grasshopper.Kernel.Data import GH_Path

import itertools

def valid_range_pairs(n):
    return [(l, r) for l in range(n + 1) for r in range(n + 1) if l < r and r - l >= 6]

# FULL
#def GenerateLocations():
#    from Grasshopper import DataTree
#    from Grasshopper.Kernel.Data import GH_Path
#
#    locations = DataTree[object]()
#    path_index = 0
#
#    x_pairs = valid_range_pairs(x)
#    y_pairs = valid_range_pairs(x)
#
#    for (x0_l, x0_r), (x1_l, x1_r), (y0_l, y0_r), (y1_l, y1_r) in itertools.product(x_pairs, x_pairs, y_pairs, y_pairs):
#        path = GH_Path(path_index)
#        for val in (x0_l, x0_r, x1_l, x1_r, y0_l, y0_r, y1_l, y1_r):
#            locations.Add(val, path)
#        path_index += 1
#
#    return locations

# FIXED Y ON SUPPORT
def GenerateLocations():
    from Grasshopper import DataTree
    from Grasshopper.Kernel.Data import GH_Path

    locations = DataTree[object]()
    path_index = 0

    x_pairs = valid_range_pairs(x)
    y_pairs = valid_range_pairs(x)

    fixed_y1 = [(2, 7)]  # <— fixed y1_l and y1_r

    for (x0_l, x0_r), (x1_l, x1_r), (y0_l, y0_r), (y1_l, y1_r) in itertools.product(x_pairs, x_pairs, y_pairs, fixed_y1):
        path = GH_Path(path_index)
        for val in (x0_l, x0_r, x1_l, x1_r, y0_l, y0_r, y1_l, y1_r):
            locations.Add(val, path)
        path_index += 1

    return locations

a = GenerateLocations()
# ---------- end ghpython_script ----------
trigger = Trigger(Interval=10, TimerInterval=10, Target=ghpython_script_6)  # disabled
trigger_2 = Trigger(Interval=2000, TimerInterval=2000, Target=ghpython_script_2)  # disabled
# Run Script
run = BooleanToggle(False)
list_item = ListItem(List=ghpython_script.a, Index=0, Wrap=True)  # -> flatten(Item)
number_slider = Slider(1295, range=0..10000)
list_length = ListLength(List=list_item)  # -> expr("x-1", Length)
ghpython_script_2 = GhPythonScript(max_index=list_length, run=run)  # -> out, index; inputs max_index: Int32, run: Boolean
# ---------- ghpython_script_2: Python ----------
import scriptcontext as sc

if not run:
    sc.sticky['simple_index'] = 0
else:
    if 'simple_index' not in sc.sticky:
        sc.sticky['simple_index'] = 0
    else:
        sc.sticky['simple_index'] += 1

index = sc.sticky['simple_index']
# ---------- end ghpython_script_2 ----------
panel = Panel(ghpython_script_2.index)
tree_branch = TreeBranch(Tree=ghpython_script.a, Path=ghpython_script_2.index, MaintainPaths=True)
list_item_2 = ListItem(List=tree_branch, Index=0, Wrap=True)  # -> flatten(Item), flatten(Item1), flatten(Item2), flatten(Item3), flatten(Item4), flatten(Item5), flatten(Item6), flatten(Item7)

construct_point = ConstructPoint(XCoordinate=list_item_2.Item1, YCoordinate=list_item_2.Item3, ZCoordinate=expr("x+1", grid_size))
construct_point_2 = ConstructPoint(XCoordinate=list_item_2.Item, YCoordinate=list_item_2.Item2, ZCoordinate=expr("x-1", grid_size))

construct_point_3 = ConstructPoint(XCoordinate=list_item_2.Item1, YCoordinate=list_item_2.Item3, ZCoordinate=grid_size)
construct_point_4 = ConstructPoint(XCoordinate=list_item_2.Item4, YCoordinate=list_item_2.Item6, ZCoordinate=-1)
construct_point_5 = ConstructPoint(XCoordinate=list_item_2.Item5, YCoordinate=list_item_2.Item7, ZCoordinate=1)
construct_point_6 = ConstructPoint(XCoordinate=list_item_2.Item4, YCoordinate=list_item_2.Item6, ZCoordinate=0)
construct_point_7 = ConstructPoint(XCoordinate=grid_size, YCoordinate=grid_size, ZCoordinate=grid_size)
box_2pt = Box2Pt(PointA=construct_point_6, PointB=construct_point_5, Plane=PlaneXY(0, 0, 0))
deconstruct_brep = DeconstructBrep(Brep=box_2pt)  # -> Faces, Edges, Vertices
box_2pt_2 = Box2Pt(PointA=construct_point_2, PointB=construct_point, Plane=PlaneXY(0, 0, 0))
box_2pt_3 = Box2Pt(PointA=construct_point_2, PointB=construct_point_3, Plane=PlaneXY(0, 0, 0))
box_2pt_4 = Box2Pt(PointA=construct_point_4, PointB=construct_point_5, Plane=PlaneXY(0, 0, 0))
list_item_3 = ListItem(List=deconstruct_brep.Faces, Index=0, Wrap=True)  # -> Item, Item1, Item2, Item3, Item4, Item5
box_2pt_5 = Box2Pt(PointA=Point(0, 0, 0), PointB=construct_point_7, Plane=PlaneXY(0, 0, 0))
brep = Brep(box_2pt_2)
brep_2 = Brep(box_2pt_4)
surface = Surface([list_item_3.Item4, list_item_3.Item3, list_item_3.Item2])
brep_3 = Brep(box_2pt_5)
deconstruct_brep_2 = DeconstructBrep(Brep=box_2pt_3)  # -> Faces, Edges, Vertices
unit_z = UnitZ(Factor=Slider(-3000, range=-3000..0))
mat = MillC_StockSupportType(X=True, Y=True, Z=True, RX=True, RY=True, RZ=True)
list_item_4 = ListItem(List=deconstruct_brep_2.Faces, Index=0, Wrap=True)  # -> Item, Item1, Item2, Item3, Item4, Item5
_3d_boundary_region = _3DBoundaryRegion(Boundary=brep_3, IsVoid=False)
surface_2 = Surface([list_item_4.Item2, list_item_4.Item3])
surface_3 = Surface(list_item_4.Item4)
_3d_support_region = _3DSupportRegion(Boundary=brep_2, SupportType=mat, AmendExistingSupports=True)
brep_edges = BrepEdges(Brep=surface_3)  # -> Naked, Interior, NonManifold
_3d_load_region = _3DLoadRegion(Boundary=brep, Load=unit_z)
topostruct_3d_model = Topostruct3DModel(ModelComponents=[_3d_boundary_region, _3d_load_region, _3d_support_region], XResolution=grid_size)  # -> FEModel, CellCentres, CellSize
topostruct_3d_solver = Topostruct3DSolver(
    FEModel=topostruct_3d_model.FEModel,
    SelfWeightCoefficient=0,
    OptimisationIterations=Slider(10, range=0..10),
    Smoothing=0.1,
    Penalization=3,
    TargetDensity=Slider(0.1, range=0..1),
    MinimumDensity=0.001,
    DeleteThreshold=0.5,
    PeriodicX=False,
    PeriodicY=False,
    PeriodicZ=False,
    LoadCase=0,
    AllCases=True)  # -> FEModel, MaxDeflection
_3d_cell_results = _3DCellResults(FEModel=topostruct_3d_solver.FEModel)  # -> PrincipalStressPlanes, PrincipalStresses, VonMisesStress, Density
point_in_brep = PointInBrep(Brep=flatten(brep_2), Point=_3d_cell_results.PrincipalStressPlanes, Strict=False)
point_in_brep_2 = PointInBrep(Brep=flatten(box_2pt_2), Point=_3d_cell_results.PrincipalStressPlanes, Strict=False)
unit_z_2 = UnitZ(Factor=1)
item_index = ItemIndex(List=point_in_brep, Item=point_in_brep)
point = Point(_3d_cell_results.PrincipalStressPlanes)
cull_pattern = CullPattern(List=point, CullPattern=point_in_brep_2)
cull_pattern_2 = CullPattern(List=item_index, CullPattern=point_in_brep_2)
cull_pattern_3 = CullPattern(List=item_index, CullPattern=point_in_brep)
move = Move(Geometry=cull_pattern, Motion=unit_z_2)  # -> Geometry, Transform
unit_z_3 = UnitZ(Factor=1)
merge = Merge(Data1=cull_pattern_2, Data2=cull_pattern_3)  # -> flatten(Result)
vector_display = VectorDisplay(Anchor=move.Geometry, Vector=expr("-x", unit_z_3))
replace_items = ReplaceItems(List=_3d_cell_results.Density, Item=1, Indices=merge, Wrap=False)
remap = RemapNumbers(Value=replace_items, Source=Domain(0, 1), Target=Domain(0, 1))  # -> Mapped, Clipped
remap_numbers = RemapNumbers(Value=replace_items, Source=Domain(0, 1), Target=Domain(0.1, 0.2))  # -> Mapped, Clipped
gradient = Gradient(
    LowerLimit=1,
    UpperLimit=0,
    Parameter=remap.Mapped,
    stops=[0: RGB(255, 29, 37), 0.5: RGB(255, 147, 30), 1: RGB(20, 223, 180)])
smaller = SmallerThan(FirstNumber=Slider(0.09, range=0..1), SecondNumber=replace_items)  # -> SmallerThan, OrEqualTo
argb = SplitARGB(Colour=gradient)  # -> Alpha, Red, Green, Blue
frgb = ColourRGBF(Alpha=smaller.SmallerThan, Red=argb.Red, Green=argb.Green, Blue=argb.Blue)
item_index_2 = ItemIndex(List=point, Item=point)
deconstruct_brep_3 = DeconstructBrep(Brep=brep_3)  # -> Faces, Edges, Vertices
dispatch = Dispatch(List=frgb, DispatchPattern=smaller.SmallerThan)  # -> ListA, ListB
dispatch_2 = Dispatch(List=item_index_2, DispatchPattern=smaller.SmallerThan)  # -> ListA, ListB
dispatch_3 = Dispatch(List=point, DispatchPattern=smaller.SmallerThan)  # -> ListA, ListB
list_item_5 = ListItem(List=deconstruct_brep_3.Vertices, Index=0, Wrap=True)  # -> Item, Item1, Item2, Item3, Item4
custom_preview = CustomPreview(
    Geometry=deconstruct_brep_3.Edges,
    Material={diffuse=RGB(192, 192, 192), emission=RGB(192, 192, 192), shine=0.5, specular=RGB(255, 255, 255), transparency=0})
proximity_3d = Proximity3D(Points=flatten(dispatch_3.ListA), Group=10, MinRadius=0.8, MaxRadius=1.5)  # -> flatten(Links), Topology
dispatch_4 = Dispatch(List=remap_numbers.Mapped, DispatchPattern=smaller.SmallerThan)  # -> ListA, ListB

line_sdl = LineSDL(
    Start=graft(deconstruct_brep_3.Vertices),
    Direction=[Vector(0, -1, 0), Vector(1, 0, 0), Vector(0, 1, 0), Vector(-1, 0, 0), Vector(0, 0, 1), Vector(0, 0, -1)],
    Length=0.25)
ghpython_script_3 = GhPythonScript(curves=flatten(line_sdl), thickness=2, color=ColourSwatch(SwatchColor=RGB(0, 0, 0)))  # -> out, a; inputs curves: list of Curve, color: Color
# ---------- ghpython_script_3: Python ----------
import Rhino
import Rhino.Display as rd
import scriptcontext as sc

STICKY_KEY = "shared_style_conduits"

# Helper to disable and remove previous conduits
def clear_conduits():
    stored = sc.sticky.get(STICKY_KEY, None)
    if stored:
        # Ensure it's a list
        if isinstance(stored, list):
            for conduit in stored:
                if conduit: conduit.Enabled = False
        else:
            # If it was a single conduit
            stored.Enabled = False
    sc.sticky[STICKY_KEY] = []

# Custom display conduit
class SharedStyleConduit(rd.DisplayConduit):
    def __init__(self, curves, color, thickness):
        self.curves = curves
        self.color = color
        self.thickness = thickness
        self.Enabled = True

    def DrawForeground(self, e):
        for crv in self.curves:
            if crv:
                e.Display.DrawCurve(crv, self.color, self.thickness)

# First run per solution: clear old conduits
if sc.sticky.get("shared_style_conduit_cleared", False) is False:
    clear_conduits()
    sc.sticky["shared_style_conduit_cleared"] = True

# Create and register new conduit
if curves and thickness > 0:
    conduit = SharedStyleConduit(curves, color, thickness)
    current = sc.sticky.get(STICKY_KEY, [])
    if not isinstance(current, list):
        current = [current]
    current.append(conduit)
    sc.sticky[STICKY_KEY] = current
    Rhino.RhinoDoc.ActiveDoc.Views.Redraw()
# ---------- end ghpython_script_3 ----------
move_2 = Move(Geometry=list_item_5.Item4, Motion=Vector(0.4, 0.4, 6))  # -> Geometry, Transform
move_3 = Move(Geometry=list_item_5.Item, Motion=Vector(1.1, 1.1, -4))  # -> Geometry, Transform
list_length_2 = ListLength(List=cull_pattern_3)
list_length_3 = ListLength(List=cull_pattern_2)
text = Text(list_length_2)
text_2 = Text(ghpython_script_2.index)
text_3 = Text(list_length_3)
concatenate = Concatenate(FragmentA="Support Count: ", FragmentB=text)
concatenate_2 = Concatenate(FragmentA="Index: ", FragmentB=text_2)
concatenate_3 = Concatenate(FragmentA="Load Count: ", FragmentB=text_3)

cloud = CloudDisplay(Points=graft(dispatch_3.ListA), Colours=graft(dispatch.ListA), Size=graft(dispatch_4.ListA), SpriteType=1)
cloud_2 = CloudDisplay(Points=dispatch_3.ListB, Colours=ColourSwatch(SwatchColor=RGB(0, 0, 0)), Size=Slider(0.05, range=0..0.1), SpriteType=1)
line = Line(proximity_3d.Links)
custom_preview_2 = CustomPreview(
    Geometry=line,
    Material={diffuse=RGB(192, 192, 192), emission=RGB(192, 192, 192), shine=0.5, specular=RGB(255, 255, 255), transparency=0})

# ---- group: Topology
data = Data(proximity_3d.Topology)

# ----
panel_2 = Panel("C:\Users\pdsie\Desktop\SPhyR_3D_10x10x10")
list_item_6 = ListItem(List=dispatch_2.ListA, Index=data, Wrap=True)  # -> simplify(Item)
move_4 = Move(Geometry=list_item_5.Item4, Motion=Vector(0.9, 0.9, 5.3))  # -> Geometry, Transform

# ---- group: Density
data_2 = Data(replace_items)

# ---- group: Locations
data_3 = Data(point)

# ----
ghpython_script_4 = GhPythonScript(x=list_item_6)  # -> out, flatten(a); inputs x: list
# ---------- ghpython_script_4: Python ----------
__author__ = "pdsie"
__version__ = "2024.11.25"

import rhinoscriptsyntax as rs

a = str(x)
# ---------- end ghpython_script_4 ----------
deconstruct = Deconstruct(Point=data_3)  # -> XComponent, YComponent, ZComponent
integer = Integer(flatten(dispatch_2.ListA))
text_4 = Text(ghpython_script_2.index)
ghpython_script_5 = GhPythonScript(
    density=data_2,
    x=deconstruct.XComponent,
    y=deconstruct.YComponent,
    z=deconstruct.ZComponent,
    node_indexes_with_neighbours=integer,
    neighbours=ghpython_script_4.a,
    static_indexes=merge)  # -> a; inputs density: list, x: list, y: list, z: list, node_indexes_with_neighbours: list of Int32, neighbours: list, static_indexes: list of Int32
# ---------- ghpython_script_5: Python ----------
__author__ = "pdsie"
__version__ = "2024.11.25"
                
import rhinoscriptsyntax as rs
                
lines = []
                
for i in range(len(density)):
    n = []
    if i in node_indexes_with_neighbours:
        n_index = node_indexes_with_neighbours.index(i)
        n = neighbours[n_index]
    static = i in static_indexes
    line = "{},{},{},{},{},{},{}".format(i, x[i], y[i], z[i], density[i], static, str(n))
    lines.append(line)
                
a = lines
# ---------- end ghpython_script_5 ----------
concatenate_4 = Concatenate(Fragment_A=panel_2, Fragment_B="\frames\", C=grid_size, D="_", A=text_4, B=".png")
text_tag = TextTag(Location=move_2.Geometry, Text=concatenate_2)
text_tag_2 = TextTag(Location=move_4.Geometry, Text=concatenate_3)
text_tag_3 = TextTag(Location=move_3.Geometry, Text=concatenate)
ghpython_script_6 = GhPythonScript(path=concatenate_4)  # -> out, a
# ---------- ghpython_script_6: Python ----------
import Rhino
import System
import scriptcontext as sc
import Grasshopper.Kernel as gh


def capture_view(filepath, width=920, height=920):
    try:
        # Get the active Rhino viewport
        view = sc.doc.Views.ActiveView
        if not view:
            raise Exception("No active view found")
        
        # Get the viewport display settings
        display_mode = view.ActiveViewport.DisplayMode
        
        # Take screenshot and save
        bitmap = view.CaptureToBitmap(System.Drawing.Size(width, height))
        if not bitmap:
            raise Exception("Failed to capture viewport")
        
        # Save the image
        bitmap.Save(filepath, System.Drawing.Imaging.ImageFormat.Png)
        print("Screenshot saved at:", filepath)
        return True
    except Exception as e:
        print("Error:", e)
        return False


# Grasshopper input parameters
file_path = path  # Change the path as needed

# Execute the screenshot function
if capture_view(file_path):
    ghenv.Component.AddRuntimeMessage(gh.GH_RuntimeMessageLevel.Remark, "Screenshot saved successfully.")
else:
    ghenv.Component.AddRuntimeMessage(gh.GH_RuntimeMessageLevel.Error, "Failed to save screenshot.")
# ---------- end ghpython_script_6 ----------
ghpython_script_7 = GhPythonScript(prefix=text_4, name="SPhyR_3D.csv", lines=ghpython_script_5, directory=panel_2)  # -> out, a; inputs lines: list
# ---------- ghpython_script_7: Python ----------
__author__ = "pdsie"
__version__ = "2024.11.25"

import rhinoscriptsyntax as rs

import os

# Inputs: 'lines' (list of strings), 'directory' (target directory)
# Example:
# lines = ["ID,Name,Value", "1,Alice,100", "2,Bob,200"]
# directory = "C:/example/path"

# Check if directory exists
if not os.path.exists(directory):
    raise ValueError("The specified directory does not exist.")

# Define the file path for the CSV
file_path = os.path.join(directory, "{}_{}".format(prefix, name))

# Write to the file
try:
    with open(file_path, "w") as file:
        # Write each string as a new line in the CSV
        for line in lines:
            file.write(line + "\n")
    result = "CSV successfully written to {}".format(file_path)
except Exception as e:
    result = "Error writing CSV: {}".format(str(e))

# Output the result for feedback
a = result
# ---------- end ghpython_script_7 ----------
panel_3 = Panel(ghpython_script_7.a)
